# Dynamo graph AllFalse - Ex 2.dyn (Dynamo 2.0.0.3336)

code_block = CodeBlock()
# ---------- code_block.designscript (12 lines) ----------
{
 {
  {"Racel","Williams"},
  {"Lilli","Smith"},
  {"Adrian","Finch"}
 },
 {
  {"Zach","Kron"},
  {"Matt","Jezyk"},
  {"Ram","Pollacs"}
 }
};
# ----------------------------------------

# group: List@Level with Shortest
firstItem = List.FirstItem(code_block@L2)

# group: Shortest
code_block_2 = CodeBlock(t1=code_block) { t2 = List.FirstItem(t1<1>); }

# group: Default = Auto
firstItem_2 = List.FirstItem(code_block)
